# Grasshopper definition gh_basics_001.gh (Grasshopper 1.0.7)
# plug-ins: Hops, Speckle 2

# ----
# VISUAL STUDIO CODE
# Python 3
# NUMPY
# PANDAS
# SCI-KIT LEARN
# TENSORFLOW
# KERAS
# rhino3dm API
# Data Science and
# Machine Learning
# txt
# binary
# csv
# excell
# sql
# class rhino3dm.Point
# Point()
# Point constructor
# 
# Point(location)
# Initializes a new point instance with a location.
# 
# Parameters:	location (rhino3dm.Point3d) – A position in 3D space.
# Location
# rhino3dm.Point3d: Gets or sets the location (position) of this point.
# P
# O
# I
# N
# T
number_slider = Slider(-1.88, range=-5..5)
construct_point = ConstructPoint(XCoordinate=number_slider, YCoordinate=Slider(0.43, range=-5..5), ZCoordinate=Slider(0.79, range=-5..5))
point = Point(construct_point)
# MUST BE RUNNING AN APP.PY FILE  IN vsc
# FOR THE BLUE HOPS COMPONENTS TO RUN
panel = Panel(point)

# ----
# class rhino3dm.Point2d
# Point2d(x, y)
# Initializes a new instance of from coordinates.
# 
# Parameters:
# x (float) – The X (first) coordinate.
# y (float) – The Y (second) coordinate.
# X
# float: Gets or sets the X (first) coordinate of the point.
# 
# Y
# float: Gets or sets the Y (second) coordinate of the point.
number_slider_2 = Slider(-2.12, range=-5..5)
construct_point_2 = ConstructPoint(XCoordinate=number_slider_2, YCoordinate=Slider(-0.9, range=-5..5), ZCoordinate="0")
point_2 = Point(construct_point_2)
panel_2 = Panel(point_2)

# ----
# classrhino3dm.Point3dList
# Point3dList()
# Point3dList constructor
# 
# Point3dList(initialCapacity)
# Initializes a new point list with a preallocated initial capacity.
# 
# Parameters:	initialCapacity (int) –
#  The number of added items before
# which the underlying array will be resized.
number_slider_3 = Slider(3.54, range=-5..5)
# P
# O
# I
# N
# T
# S
number_slider_4 = Slider(-3.33, range=-5..5)
number_slider_5 = Slider(3, range=0..10)
range = Range(Domain=number_slider_4, Steps=number_slider_5)
range_2 = Range(Domain=number_slider_3, Steps=number_slider_5)
graft_tree = GraftTree(Tree=range, IncludeEmptyLists=True, IncludeNullItems=True)
construct_point_3 = ConstructPoint(XCoordinate=graft_tree, YCoordinate=range_2, ZCoordinate=0)
point_3 = Point(construct_point_3)

# ----
# Line
# classrhino3dm.Line
# Line(from, to)
# Constructs a new line segment between two points.
# 
# Parameters:
# from (rhino3dm.Point3d) – Start point of line.
# to (rhino3dm.Point3d) – End point of line.
# L
# I
# N
# E
panel_3 = Panel("12")
construct_point_4 = ConstructPoint(XCoordinate=0, YCoordinate=panel_3, ZCoordinate=0)
construct_point_5 = ConstructPoint(XCoordinate=panel_3, YCoordinate=0, ZCoordinate=0)
line = Line(StartPoint=construct_point_5, EndPoint=construct_point_4)
panel_4 = Panel(line)

# ----
# """
# classrhino3dm.Arc
# Arc(circle, angleRadians)
# Initializes a new instance of an arc from a base circle and an angle.
# 
# Parameters:
# circle (Circle) – Circle to base arc upon.
# angleRadians (float) – Sweep angle of arc (in radians)
# """
number_slider_6 = Slider(0.72, range=0..1)
# A
# R
# C
# S
number_slider_7 = Slider(7, range=0..10)
pi = Pi(Factor=number_slider_6)
modified_arc = ModifiedArc()
arc_sed = ArcSED()  # -> Arc, Plane, Radius
biarc = BiArc(Ratio=0.5)  # -> FirstArc, SecondArc, BiArc
tangent_arcs = TangentArcs()  # -> ArcA, ArcB
arc = Arc(Plane=PlaneXY(0, 0, 0), Radius=number_slider_7, Angle=pi)  # -> Arc, Length
arc_3pt = Arc3Pt()  # -> Arc, Plane, Radius
circular_arc = CircularArc(arc.Arc)
panel_5 = Panel(circular_arc)

# ----
# Plane
# classrhino3dm.Plane
# Plane()
# Plane constructor
# 
# Plane(origin, normal)
# Constructs a plane from a point and a normal vector.
# 
# Parameters:
# origin (rhino3dm.Point3d) – Origin point of the plane.
# normal (rhino3dm.Vector3d) – Non-zero normal to the plane.
gene_pool = GenePool(Decimals=2, Maximum=5, Minimum=-5, Value=[-0.9750792831, 1.637714099, -3.422210607])
gene_pool_2 = GenePool(Decimals=2, Maximum=5, Minimum=-5, Value=[-3.795345695, 2.117710294, -0.4899169158])
gene_pool_3 = GenePool(Decimals=2, Maximum=5, Minimum=-5, Value=[-0.9818539703, 1.999845978, -2.447806009])
gene_pool_4 = GenePool(
    Decimals=2,
    Maximum=5,
    Minimum=-5,
    Value=[-2.377896107, 1.922648194, -1.304362862, 1.886869924, -3.357855304, 3.650043848, -3.698868863, -2.943737809, -0.2272489924, -1.455118235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])
gene_pool_5 = GenePool(
    Decimals=2,
    Maximum=5,
    Minimum=-5,
    Value=[3.924586698, -4.849976664, 1.103417392, 4.951885482, 3.776983921, 0.3937752803, 2.749715917, 3.096025082, -1.79452957, -0.6680067003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])
gene_pool_6 = GenePool(
    Decimals=2,
    Maximum=5,
    Minimum=-5,
    Value=[1.11187781, -1.971956565, -1.123288165, 3.716453346, 0.6746940388, 4.886755925, -3.596468856, 3.371986881, -2.895188065, -1.181453069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])
# P
# L
# A
# N
# E
number_slider_8 = Slider(-1.88, range=-5..5)
construct_point_6 = ConstructPoint(XCoordinate=gene_pool, YCoordinate=gene_pool_2, ZCoordinate=gene_pool_3)
construct_point_7 = ConstructPoint(XCoordinate=gene_pool_4, YCoordinate=gene_pool_5, ZCoordinate=gene_pool_6)
construct_point_8 = ConstructPoint(XCoordinate=number_slider_8, YCoordinate=Slider(0.43, range=-5..5), ZCoordinate=Slider(0.79, range=-5..5))
vector_xyz = VectorXYZ(XComponent=Slider(5, range=-5..5), YComponent=Slider(0.57, range=-5..5), ZComponent=Slider(2.98, range=-5..5))  # -> Vector, Length
point_4 = Point(construct_point_6)
point_5 = Point(construct_point_7)
vector_display = VectorDisplay(Anchor=construct_point_8, Vector=vector_xyz.Vector)
point_6 = Point(construct_point_8)
list_item = ListItem(List=point_4, Index=0, Wrap=True)  # -> Item, Item1, Item2
plane_fit = PlaneFit(Points=point_5)  # -> Plane, Deviation
panel_6 = Panel(point_6)
plane_3pt = Plane3Pt(PointA=list_item.Item, PointB=list_item.Item1, PointC=list_item.Item2)
construct_plane = ConstructPlane(Origin=point_6, XAxis=vector_xyz.Vector, YAxis=Vector(0, 1, 0))
construct_plane_2 = ConstructPlane(Origin=point_6, XAxis=Vector(1, 0, 0), YAxis=vector_xyz.Vector)
plane_normal = PlaneNormal(Origin=point_6, ZAxis=vector_xyz.Vector)
panel_7 = Panel(plane_fit.Deviation)
plane = Plane(construct_plane)
plane_2 = Plane(construct_plane_2)
plane_3 = Plane(plane_normal)
plane_4 = Plane(plane_3pt)
plane_5 = Plane(plane_fit.Plane)

# ----
# PointGrid
# classrhino3dm.PointGrid
# PointGrid()
# PointGrid constructor
# P
# O
# I
# N
# T
# G
# R
# I
# D
number_slider_9 = Slider(0.36, range=0..1)
number_slider_10 = Slider(1, range=0..1)
number_slider_11 = Slider(2, range=0..10)
construct_point_9 = ConstructPoint(XCoordinate=0, YCoordinate=0, ZCoordinate=0)
number_slider_12 = Slider(2, range=0..10)
vector_xyz_2 = VectorXYZ(XComponent=number_slider_9, YComponent=number_slider_10, ZComponent=Slider(0.48, range=0..1))  # -> Vector, Length
construct_plane_3 = ConstructPlane(Origin=construct_point_9, XAxis=vector_xyz_2.Vector, YAxis=Vector(0, 1, 0))
rectangular = Rectangular(
    Plane=construct_plane_3,
    SizeX=vector_xyz_2.Vector,
    SizeY=number_slider_10,
    ExtentX=number_slider_11,
    ExtentY=number_slider_12)  # -> Cells, Points
square = Square(Plane=construct_plane_3, Size=vector_xyz_2.Vector, ExtentX=number_slider_11, ExtentY=number_slider_12)  # -> Cells, Points
triangular = Triangular(Plane=construct_plane_3, Size=vector_xyz_2.Vector, ExtentX=number_slider_11, ExtentY=number_slider_12)  # -> Cells, Points
hexagonal = Hexagonal(Plane=construct_plane_3, Size=vector_xyz_2.Vector, ExtentX=number_slider_11, ExtentY=number_slider_12)  # -> Cells, Points

# ----
# Vector
# classrhino3dm.Vector2d
# Vector2d(x, y)
# Initializes a new instance of the vector
#  based on two, X and Y, components.
# 
# Parameters:
# x (float) – The X (first) component.
# y (float) – The Y (second) component.
# 
# vector2dim
# V
# E
# C
# T
# O
# R
number_slider_13 = Slider(0.4, range=0..1)
# I
# N
# T
# E
# R
# V
# A
# L
number_slider_14 = Slider(0.56, range=0..1)
construct_point_10 = ConstructPoint(XCoordinate=0, YCoordinate=0, ZCoordinate=0)
vector2dim = Hops(
    X=number_slider_13,
    Y=number_slider_14,
    CacheResultsInMemory=True,
    CacheSolveResults=True,
    RemoteDefinitionLocation="http://127.0.0.1:5000/vector2dim",
    RemoteSolveVersion=(0, 1, 0),
    ShowInput_Enabled=False,
    ShowInput_Path=False,
    SynchronousSolve=True)  # -> Success, Vector2d
panel_8 = Panel(vector2dim.Vector2d)
panel_9 = Panel(vector2dim.Success)
vector = Vector(vector2dim.Vector2d)
vector_display_2 = VectorDisplay(Anchor=construct_point_10, Vector=vector)

# ----
# """curve domain
# Domain
# rhino3dm.Interval: Gets or sets the domain of the curve.
# """
# crvDomainT0T1
# C
# U
# R
# V
# E
# S
panel_10 = Panel("6")
populate_2d = Populate2D(Region={Plane=PlaneXY(0, 0, 0), Size=Domain2(u=0..20, v=0..10)}, Count=panel_10, Seed=1)
interpolate = Interpolate(Vertices=populate_2d, Degree=3, Periodic=False, KnotStyle=1)  # -> Curve, Length, Domain
curve_domain = CurveDomain(Curve=interpolate.Curve)  # -> Curve, Domain
panel_11 = Panel(curve_domain.Domain)

# ----
# Interval
# classrhino3dm.Interval
# Interval(t0, t1)
# Initializes a new instance of the Rhino.Geometry.Interval class.
# 
# Parameters:
# t0 (float) – The first value.
# t1 (float) – The second value.
# T0
# float: Gets or sets the lower bound of the Interval.
# 
# T1
# float: Gets or sets the upper bound of the Interval.
number_slider_15 = Slider(0.21, range=0..1)
construct_domain = ConstructDomain(DomainStart=number_slider_15, DomainEnd=Slider(0.82, range=0..1))
construct_domain_2 = ConstructDomain(DomainStart=Slider(0.21, range=0..1), DomainEnd=Slider(0.82, range=0..1))
construct_domain_3 = ConstructDomain(DomainStart=Slider(0.21, range=0..1), DomainEnd=Slider(0.82, range=0..1))
construct_domain² = ConstructDomain²(
    UMin=Slider(0.21, range=0..1),
    UMax=Slider(0.82, range=0..1),
    VMin=Slider(0.21, range=0..1),
    VMax=Slider(0.82, range=0..1))
construct_domain²_2 = ConstructDomain²(DomainU=construct_domain_2, DomainV=construct_domain_3)
panel_12 = Panel(construct_domain)
panel_13 = Panel(construct_domain²)
panel_14 = Panel(construct_domain²_2)

end_points = EndPoints(Curve=interpolate.Curve)  # -> Start, End
point_7 = Point(end_points.End)
point_8 = Point(end_points.Start)
panel_15 = Panel(point_7)
panel_16 = Panel(point_8)

crvdomaint0t1 = Hops(
    Curve=interpolate.Curve,
    CacheResultsInMemory=True,
    CacheSolveResults=True,
    RemoteDefinitionLocation="http://127.0.0.1:5000/crvDomainT0T1",
    RemoteSolveVersion=(0, 1, 0),
    ShowInput_Enabled=False,
    ShowInput_Path=False,
    SynchronousSolve=True)  # -> T0, T1
panel_17 = Panel([crvdomaint0t1.T0, crvdomaint0t1.T1])

# ----
# """
# curve dimension
# Dimension
# int: Gets the dimension of the object.
# The dimension is typically three.
# For parameter space trimming curves the dimension is two.
# In rare cases the dimension can be one or greater than three.
# """
# crvDimension
crvdimension = Hops(
    Curve=interpolate.Curve,
    CacheResultsInMemory=True,
    CacheSolveResults=True,
    RemoteDefinitionLocation="http://127.0.0.1:5000/crvDimension",
    RemoteSolveVersion=(0, 1, 0),
    ShowInput_Enabled=False,
    ShowInput_Path=False,
    SynchronousSolve=True)
panel_18 = Panel(crvdimension)

# ----
# """
# curve degree
# Degree
# int: Gets the maximum algebraic degree
# of any span or a good estimate if
# curve spans are not algebraic.
# """
# crvDegree
crvdegree = Hops(
    Curve=interpolate.Curve,
    CacheResultsInMemory=True,
    CacheSolveResults=True,
    RemoteDefinitionLocation="http://127.0.0.1:5000/crvDegree",
    RemoteSolveVersion=(0, 1, 0),
    ShowInput_Enabled=False,
    ShowInput_Path=False,
    SynchronousSolve=True)
panel_19 = Panel(crvdegree)

# ----
# """
# curve PointAtStart
# PointAtStart
# rhino3dm.Point3d:
# Evaluates point at the start of the curve.
# """
# crvPointAtStart
crvpointatstart = Hops(
    Curve=interpolate.Curve,
    CacheResultsInMemory=True,
    CacheSolveResults=True,
    RemoteDefinitionLocation="http://127.0.0.1:5000/crvPointAtStart",
    RemoteSolveVersion=(0, 1, 0),
    ShowInput_Enabled=False,
    ShowInput_Path=False,
    SynchronousSolve=True)
point_9 = Point(crvpointatstart)
# http://127.0.0.1:5000
panel_20 = Panel(point_9)

# ----
# """
# curve PointAtEnd
# PointAtEnd
# rhino3dm.Point3d:
# Evaluates point at the end of the curve.
# """
# crvPointAtEnd
crvpointatend = Hops(
    Curve=interpolate.Curve,
    CacheResultsInMemory=True,
    CacheSolveResults=True,
    RemoteDefinitionLocation="http://127.0.0.1:5000/crvPointAtEnd",
    RemoteSolveVersion=(0, 1, 0),
    ShowInput_Enabled=False,
    ShowInput_Path=False,
    SynchronousSolve=True)
point_10 = Point(crvpointatend)
panel_21 = Panel(point_10)

line_line = LineLine()
line_pt = LinePt()

plane_6 = Plane(rectangular.Points)
flatten_tree = FlattenTree(Tree=point_3, Path="{0}")

# ----
# Distance To(other)
# Computes the distance between two points.
# 
# Parameters:	other (rhino3dm.Point2d) –
# Another point.
# Returns:	The length of the line between
# the two points, or 0 if either point is invalid.
# Return type:	float
distance = Distance(PointA=point, PointB=point_2)
number = Number(distance)
panel_22 = Panel(number)

range_3 = Range(Domain=Slider(3.82, range=-5..5), Steps=number_slider_5)
graft_tree_2 = GraftTree(Tree=flatten_tree, IncludeEmptyLists=True, IncludeNullItems=True)
unit_z = UnitZ(Factor=range_3)
move = Move(Geometry=graft_tree_2, Motion=unit_z)  # -> Geometry, Transform

panel_23 = Panel(flatten_tree)

# ----
# Plane()
# Constructs a plane from an equation Ax+By+Cz+D=0.
number_slider_16 = Slider(2, range=0..10)
planefromequation2 = Hops(
    A=number_slider_16,
    X=Slider(0, range=0..10),
    B=Slider(4, range=0..10),
    Y=Slider(1.12, range=0..10),
    C=Slider(3, range=0..10),
    Z=Slider(1.73, range=0..10),
    D=Slider(3, range=0..10),
    CacheResultsInMemory=True,
    CacheSolveResults=True,
    RemoteDefinitionLocation="http://127.0.0.1:5000/planeFromEquation2",
    RemoteSolveVersion=(0, 1, 0),
    ShowInput_Enabled=False,
    ShowInput_Path=False,
    SynchronousSolve=True)  # -> Success, Slope, Origin, Normal
panel_24 = Panel(planefromequation2.Slope)
panel_25 = Panel(planefromequation2.Success)
point_11 = Point(planefromequation2.Origin)
vector_2 = Vector(planefromequation2.Normal)
panel_26 = Panel([panel_25, panel_24, point_11, vector_2])
construct_plane_4 = ConstructPlane(Origin=point_11, XAxis=vector_2, YAxis=Vector(0, 1, 0))
construct_plane_5 = ConstructPlane(Origin=point_11, XAxis=Vector(1, 0, 0), YAxis=vector_2)
plane_normal_2 = PlaneNormal(Origin=point_11, ZAxis=vector_2)

curve = Curve(interpolate.Curve)

evaluate_curve = EvaluateCurve(Curve=reparameterize(curve), Parameter=Slider(0.31, range=0..1))  # -> Point, Tangent, Angle
derivatives = Derivatives(Curve=reparameterize(curve), Parameter=Slider(0.44, range=0..1))  # -> Point, FirstDerivative, SecondDerivative, ThirdDerivative
vector_3 = Vector(derivatives.FirstDerivative)
vector_4 = Vector(derivatives.SecondDerivative)
vector_5 = Vector(derivatives.ThirdDerivative)
vector_6 = Vector(evaluate_curve.Tangent)
vector_display_3 = VectorDisplay(Anchor=derivatives.Point, Vector=vector_3)
vector_display_4 = VectorDisplay(Anchor=derivatives.Point, Vector=vector_4)
vector_display_5 = VectorDisplay(Anchor=derivatives.Point, Vector=vector_5)
vector_display_6 = VectorDisplay(Anchor=evaluate_curve.Point, Vector=vector_6)

# ----
# """
# curve TangentAtEnd
# TangentAtEnd
# rhino3dm.Vector3d: Evaluates the unit
# tangent vector at the end of the curve.
# """
# crvTangentAtEnd
curve_2 = Curve(curve)
crvtangentatend = Hops(
    Curve=curve_2,
    CacheResultsInMemory=True,
    CacheSolveResults=True,
    RemoteDefinitionLocation="http://127.0.0.1:5000/crvTangentAtEnd",
    RemoteSolveVersion=(0, 1, 0),
    ShowInput_Enabled=False,
    ShowInput_Path=False,
    SynchronousSolve=True)
panel_27 = Panel(crvtangentatend)
vector_7 = Vector(crvtangentatend)
vector_display_7 = VectorDisplay(Anchor=point_10, Vector=vector_7)

# ----
# """
# curve TangentAtStart
# TangentAtStart
# rhino3dm.Vector3d: Evaluates the unit
# tangent vector at the start of the curve.
# """
# crvTangentAtStart
crvtangentatstart = Hops(
    Curve=curve,
    CacheResultsInMemory=True,
    CacheSolveResults=True,
    RemoteDefinitionLocation="http://127.0.0.1:5000/crvTangentAtStart",
    RemoteSolveVersion=(0, 1, 0),
    ShowInput_Enabled=False,
    ShowInput_Path=False,
    SynchronousSolve=True)
panel_28 = Panel(crvtangentatstart)
vector_8 = Vector(crvtangentatstart)
vector_display_8 = VectorDisplay(Anchor=point_9, Vector=vector_8)

# ----
# Transform(xform)
# Transforms the present point in place.
# The transformation matrix acts on the left of the point.
# i.e., result = transformation*point
# 
# Parameters:	xform (Transform) – Transformation to apply.
# Return type:	void
y_component = YComponent(0)
z_component = ZComponent(0)
vector_xyz_3 = VectorXYZ(XComponent=number, YComponent=y_component, ZComponent=z_component)  # -> Vector, Length
move_2 = Move(Geometry=point, Motion=vector_xyz_3.Vector)  # -> Geometry, Transform
point_12 = Point(move_2.Geometry)
panel_29 = Panel(point_12)

digit_scroller = DigitScroller(Scroller_Digits=12, Scroller_Prefix="Digit Scroller", Scroller_Radix=9, Scroller_Value=0.25)

# ----
# Insert(index, item)
# [todo] add documentation
# 
# Add(x, y, z)
# Adds a Point3d to the end of the
#  list with given x,y,z coordinates.
# 
# Parameters:
# x (float) – The X coordinate.
# y (float) – The Y coordinate.
# z (float) – The Z coordinate.
# Return type:
# voidentation
number_slider_17 = Slider(0.76, range=-5..5)
construct_point_11 = ConstructPoint(XCoordinate=number_slider_17, YCoordinate=Slider(0.53, range=-5..5), ZCoordinate=Slider(2.58, range=-5..5))
point_13 = Point(construct_point_11)
merge = Merge(Data1=move.Geometry, Data2=point_13)
panel_30 = Panel(point_13)

# ----
# PlaneSurface
# PlaneSurface
# classrhino3dm.PlaneSurface
# PlaneSurface()
# PlaneSurface constructor
# 
# PlaneSurface()
# PlaneSurface constructor
number_slider_18 = Slider(1, range=0..10)
number_slider_19 = Slider(2.88, range=0..10)
sphere = Sphere(Base=PlaneXY(0, 0, 0), Radius=number_slider_18)
negative = Negative(Value=number_slider_19)
number_slider_20 = Slider(1, range=0..1)
number_slider_21 = Slider(1, range=0..10)
construct_point_12 = ConstructPoint(XCoordinate=Slider(0.35, range=0..1), YCoordinate=Slider(0.82, range=0..1), ZCoordinate="0")
construct_domain_4 = ConstructDomain(DomainStart=negative, DomainEnd=number_slider_19)
construct_domain_5 = ConstructDomain(DomainStart=negative, DomainEnd=number_slider_19)
evaluate_surface = EvaluateSurface(Surface=reparameterize(sphere), Point=construct_point_12)  # -> Point, Normal, UDirection, VDirection, Frame
range_4 = Range(Domain=construct_domain_5, Steps=number_slider_21)
range_5 = Range(Domain=construct_domain_4, Steps=number_slider_21)
plane_7 = Plane(evaluate_surface.Frame)
deconstruct_plane = DeconstructPlane(Plane=plane_7)  # -> Origin, XAxis, YAxis, ZAxis
multiplication = Multiplication(A=deconstruct_plane.XAxis, B=range_5)
multiplication_2 = Multiplication(A=deconstruct_plane.YAxis, B=range_4)
move_3 = Move(Geometry=deconstruct_plane.Origin, Motion=multiplication)  # -> Geometry, Transform
move_4 = Move(Geometry=deconstruct_plane.Origin, Motion=multiplication_2)  # -> Geometry, Transform
dispatch = Dispatch(List=flatten(move_3.Geometry), DispatchPattern=[True, False])  # -> ListA, ListB
dispatch_2 = Dispatch(List=flatten(move_4.Geometry), DispatchPattern=[True, False])  # -> ListA, ListB
pi_2 = Pi(Factor=Slider(2, range=0..2))
_4point_surface = _4PointSurface(CornerA=dispatch.ListA, CornerB=dispatch_2.ListA, CornerC=dispatch.ListB, CornerD=dispatch_2.ListB)
rotate_3d = Rotate3D(Geometry=_4point_surface, Angle=pi_2, Center=deconstruct_plane.Origin, Axis=Vector(0, 0, 1))  # -> Geometry, Transform
rotate_3d_2 = Rotate3D(Geometry=_4point_surface, Angle=pi_2, Center=deconstruct_plane.Origin, Axis=evaluate_surface.Normal)  # -> Geometry, Transform

vector_xyz_4 = VectorXYZ(XComponent=0, YComponent=0, ZComponent="1")  # -> Vector, Length
construct_point_13 = ConstructPoint(XCoordinate=0, YCoordinate=0, ZCoordinate=0)
planesurface17 = Hops(
    Surface=reparameterize(sphere),
    Origin=construct_point_13,
    Normal=vector_xyz_4.Vector,
    UMin=Slider(0.13, range=0..1),
    UMax=Slider(0.58, range=0..1),
    VMin=Slider(0.13, range=0..1),
    VMax=Slider(0.58, range=0..1),
    CacheResultsInMemory=True,
    CacheSolveResults=True,
    RemoteDefinitionLocation="http://127.0.0.1:5000/planeSurface17",
    RemoteSolveVersion=(0, 1, 0),
    ShowInput_Enabled=False,
    ShowInput_Path=False,
    SynchronousSolve=True)  # -> Success, Surface
panel_31 = Panel([planesurface17.Success, planesurface17.Surface])

construct_plane_6 = ConstructPlane(Origin=Point(0, 0, 0), XAxis=Vector(1, 0, 0), YAxis=Vector(0, 1, 0))
boundary_surfaces = BoundarySurfaces(Edges=construct_plane_6)

entwine = Entwine(FlattenInputs=True)
flatten_tree_2 = FlattenTree(Tree=merge, Path="{0}")

# ----
# __len__()
# [todo] add documentation
list_length = ListLength(List=flatten_tree_2)
panel_32 = Panel(list_length)

# ----
# RemoveAt(index)
# [todo] add documentation
number_slider_22 = Slider(3, range=0..10)
subtraction = Subtraction(A=list_length, B="-1")
construct_domain_6 = ConstructDomain(DomainStart=0, DomainEnd=subtraction)
division = Division(A=list_length, B=number_slider_22)
gene_pool_7 = GenePool(
    Decimals=0,
    Maximum=1,
    Minimum=0,
    Value=[0.5464361499, 0.1175285304, 0.7159971254, 0.909070583, 0.4615059045, 0.4147940755, 0.4035549147, 0.5854838326, 0.3117198159, 0.8505309833])
range_6 = Range(Domain=construct_domain_6, Steps=division)
integer = Integer(range_6)
cull_pattern = CullPattern(List=integer, CullPattern=gene_pool_7)
random_reduce = RandomReduce(List=flatten_tree_2, Reduction=Slider(45, range=0..100), Seed=Slider(516, range=0..1000))
cull_index = CullIndex(List=flatten_tree_2, Indices=integer, Wrap=True)
cull_index_2 = CullIndex(List=flatten_tree_2, Indices=cull_pattern, Wrap=True)
panel_33 = Panel(integer)

list_length_2 = ListLength(List=integer)
panel_34 = Panel(list_length_2)
point_14 = Point(cull_index_2)
point_15 = Point(cull_index)
point_16 = Point(random_reduce)

# ----
# Transform(xform)
# Applies a transform to all the points in the list.
# 
# Parameters:	xform (Transform) – Transform to apply.
# Return type:	void
number_slider_23 = Slider(-0.91, range=-5..5)
vector_xyz_5 = VectorXYZ(XComponent=Slider(-1.82, range=-5..5), YComponent=Slider(1.14, range=-5..5), ZComponent=Slider(1.06, range=-5..5))  # -> Vector, Length
construct_point_14 = ConstructPoint(XCoordinate=number_slider_23, YCoordinate=Slider(-0.36, range=-5..5), ZCoordinate=Slider(0.28, range=-5..5))
pi_3 = Pi(Factor=Slider(1.17, range=0..2))
point_17 = Point(construct_point_14)
rotate_3d_3 = Rotate3D(Geometry=point_16, Angle=pi_3, Center=point_17, Axis=vector_xyz_5.Vector)  # -> Geometry, Transform
vector_display_9 = VectorDisplay(Anchor=point_17, Vector=vector_xyz_5.Vector)
point_18 = Point(rotate_3d_3.Geometry)

# ----
# Union Box
bounding_box = BoundingBox(Content=point_18, Plane=PlaneXY(0, 0, 0), UnionBox=True)  # -> Box, Box_2
bounding_box_2 = BoundingBox(Content=point_15, Plane=PlaneXY(0, 0, 0), UnionBox=True)  # -> Box, Box_2
bounding_box_3 = BoundingBox(Content=point_14, Plane=PlaneXY(0, 0, 0), UnionBox=True)  # -> Box, Box_2

box = Box(bounding_box_2.Box)
box_2 = Box(bounding_box_3.Box)
box_3 = Box(bounding_box.Box)
number_slider_24 = Slider(2.13, range=0..10)
number_slider_25 = Slider(2.13, range=0..10)
plane_8 = Plane(construct_plane_3)
sphere_2 = Sphere(Base=PlaneXY(0, 0, 0), Radius=Slider(10, range=0..10))
negative_2 = Negative(Value=number_slider_24)
negative_3 = Negative(Value=number_slider_25)
number_slider_26 = Slider(1, range=0..1)
deconstruct_plane_2 = DeconstructPlane(Plane=plane_8)  # -> Origin, XAxis, YAxis, ZAxis
number_slider_27 = Slider(1, range=0..1)
construct_point_15 = ConstructPoint(XCoordinate=Slider(0.42, range=0..1), YCoordinate=Slider(0.82, range=0..1), ZCoordinate="0")
construct_domain_7 = ConstructDomain(DomainStart=negative_2, DomainEnd=number_slider_24)
construct_domain_8 = ConstructDomain(DomainStart=negative_2, DomainEnd=number_slider_24)
construct_domain_9 = ConstructDomain(DomainStart=negative_3, DomainEnd=number_slider_25)
construct_domain_10 = ConstructDomain(DomainStart=negative_3, DomainEnd=number_slider_25)
evaluate_surface_2 = EvaluateSurface(Surface=reparameterize(sphere_2), Point=construct_point_15)  # -> Point, Normal, UDirection, VDirection, Frame
range_7 = Range(Domain=construct_domain_8, Steps=number_slider_26)
range_8 = Range(Domain=construct_domain_7, Steps=number_slider_26)
range_9 = Range(Domain=construct_domain_10, Steps=number_slider_27)
range_10 = Range(Domain=construct_domain_9, Steps=number_slider_27)
plane_9 = Plane(plane_8)
plane_10 = Plane(evaluate_surface_2.Frame)

# ----
# Oscillation
trigger = Trigger(Interval=20, TimerInterval=20, Target=data_recorder)
# SANDBOX
panel_35 = Panel("1")
data_recorder = DataRecorder(panel_35, DataLimit=10000, RecordData=False)
list_length_3 = ListLength(List=data_recorder)
division_2 = Division(A=list_length_3, B=Slider(17, range=0..1000))
panel_36 = Panel("10")
cosine = Cosine(Value=division_2)
sine = Sine(Value=division_2)
absolute = Absolute(Value=cosine)
construct_point_16 = ConstructPoint(XCoordinate=cosine, YCoordinate=0, ZCoordinate="1")
construct_point_17 = ConstructPoint(XCoordinate=sine, YCoordinate=0, ZCoordinate="1")
panel_37 = Panel(absolute)
sphere_3 = Sphere(Base=construct_point_16, Radius=absolute)
sphere_4 = Sphere(Base=construct_point_17, Radius=sine)

deconstruct_plane_3 = DeconstructPlane(Plane=plane_9)  # -> Origin, XAxis, YAxis, ZAxis
deconstruct_plane_4 = DeconstructPlane(Plane=plane_10)  # -> Origin, XAxis, YAxis, ZAxis
multiplication_3 = Multiplication(A=deconstruct_plane_3.XAxis, B=range_8)
multiplication_4 = Multiplication(A=deconstruct_plane_3.YAxis, B=range_7)
multiplication_5 = Multiplication(A=deconstruct_plane_4.XAxis, B=range_10)
multiplication_6 = Multiplication(A=deconstruct_plane_4.YAxis, B=range_9)
move_5 = Move(Geometry=deconstruct_plane_3.Origin, Motion=multiplication_3)  # -> Geometry, Transform
move_6 = Move(Geometry=deconstruct_plane_3.Origin, Motion=multiplication_4)  # -> Geometry, Transform
move_7 = Move(Geometry=deconstruct_plane_4.Origin, Motion=multiplication_5)  # -> Geometry, Transform
move_8 = Move(Geometry=deconstruct_plane_4.Origin, Motion=multiplication_6)  # -> Geometry, Transform
send = Send(
    Stream="https://speckle.xyz/streams/ab4c314c63",
    Message="THIS IS AWESOME!!!",
    Data=sphere_3,
    AutoSend=False,
    CurrentComponentState="expired",
    KitName="Objects",
    UseDefaultCache=True,
    selectedKitName="Objects")
dispatch_3 = Dispatch(List=flatten(move_5.Geometry), DispatchPattern=[True, False])  # -> ListA, ListB
dispatch_4 = Dispatch(List=flatten(move_6.Geometry), DispatchPattern=[True, False])  # -> ListA, ListB
# ROBBY
# THE
# ROBOT
merge_2 = Merge(Data1=sphere_3, Data2=sphere_4)
dispatch_5 = Dispatch(List=flatten(move_7.Geometry), DispatchPattern=[True, False])  # -> ListA, ListB
dispatch_6 = Dispatch(List=flatten(move_8.Geometry), DispatchPattern=[True, False])  # -> ListA, ListB
pi_4 = Pi(Factor=Slider(2, range=0..2))
pi_5 = Pi(Factor=Slider(0.6, range=0..2))
panel_38 = Panel(send)
_4point_surface_2 = _4PointSurface(CornerA=dispatch_3.ListA, CornerB=dispatch_4.ListA, CornerC=dispatch_3.ListB, CornerD=dispatch_4.ListB)
_4point_surface_3 = _4PointSurface(CornerA=dispatch_5.ListA, CornerB=dispatch_6.ListA, CornerC=dispatch_5.ListB, CornerD=dispatch_6.ListB)
rotate_3d_4 = Rotate3D(Geometry=_4point_surface_2, Angle=pi_4, Center=deconstruct_plane_3.Origin, Axis=Vector(0, 0, 1))  # -> Geometry, Transform
rotate_3d_5 = Rotate3D(Geometry=_4point_surface_2, Angle=pi_4, Center=deconstruct_plane_3.Origin, Axis=deconstruct_plane_2.ZAxis)  # -> Geometry, Transform
rotate_3d_6 = Rotate3D(Geometry=_4point_surface_3, Angle=pi_5, Center=deconstruct_plane_4.Origin, Axis=Vector(0, 0, 1))  # -> Geometry, Transform
rotate_3d_7 = Rotate3D(Geometry=_4point_surface_3, Angle=pi_5, Center=deconstruct_plane_4.Origin, Axis=evaluate_surface_2.Normal)  # -> Geometry, Transform

linefromab = Hops(
    A=construct_point_5,
    B=construct_point_4,
    CacheResultsInMemory=True,
    CacheSolveResults=True,
    RemoteDefinitionLocation="http://127.0.0.1:5000/lineFromAB",
    RemoteSolveVersion=(0, 1, 0),
    ShowInput_Enabled=False,
    ShowInput_Path=False,
    SynchronousSolve=True)  # -> Success, Line
panel_39 = Panel(linefromab.Success)

line_2 = Line(linefromab.Line)

panel_40 = Panel(line_2)

# ----
# """
# classrhino3dm.Vector3d
# Vector3d(x, y, z)
# Initializes a new instance of a vector, using its three components.
# 
# Parameters:
# x (float) – The X (first) component.
# y (float) – The Y (second) component.
# z (float) – The Z (third) component.
# X
# float: Gets or sets the X (first) component of the vector.
# 
# Y
# float: Gets or sets the Y (second) component of the vector.
# 
# Z
# float: Gets or sets the Z (third) component of the vector.
# """
number_slider_28 = Slider(2, range=0..10)
construct_point_18 = ConstructPoint(XCoordinate=0, YCoordinate=0, ZCoordinate=0)

vector3dim = Hops(
    X=number_slider_28,
    Y=Slider(10, range=0..10),
    Z=Slider(7.9, range=0..10),
    CacheResultsInMemory=True,
    CacheSolveResults=True,
    RemoteDefinitionLocation="http://127.0.0.1:5000/vector3dim",
    RemoteSolveVersion=(0, 1, 0),
    ShowInput_Enabled=False,
    ShowInput_Path=False,
    SynchronousSolve=True)  # -> Success, Vector3d

panel_41 = Panel(vector3dim.Vector3d)
panel_42 = Panel(vector3dim.Success)
vector_9 = Vector(vector3dim.Vector3d)
vector_display_10 = VectorDisplay(Anchor=construct_point_18, Vector=vector_9)
