# Grasshopper definition rhino3dm_hops_planes_004.gh (Grasshopper 1.0.7)
# plug-ins: Hops

# ----
# createVector
# Breps
# Surfaces
# Points
# Curves
# createLine
# createCurve
number_slider = Slider(15, range=0..100)
number_slider_2 = Slider(35, range=0..100)
number_slider_3 = Slider(45, range=0..100)
number_slider_4 = Slider(6, range=0..100)
# hops server with flask
# rhino3dm in app.py
# Getting Started with
# rhino3dm development
# API for Python 3.10
number_slider_5 = Slider(17, range=0..100)
createpoint = Hops(
    X=[number_slider, number_slider_2, number_slider_3],
    Y=[number_slider, number_slider_2, number_slider_3, number_slider_4],
    Z=[number_slider, number_slider_3, number_slider_4],
    CacheResultsInMemory=True,
    CacheSolveResults=True,
    RemoteDefinitionLocation="http://127.0.0.1:5000/createpoint",
    RemoteSolveVersion=(0, 1, 0),
    ShowInput_Enabled=False,
    ShowInput_Path=False,
    SynchronousSolve=True)
explode_tree = ExplodeTree(Data=graft(createpoint))  # -> Branch0, Branch1, Branch2, Branch3
createvector = Hops(
    X=number_slider_5,
    Y=number_slider_5,
    Z=number_slider_5,
    CacheResultsInMemory=True,
    CacheSolveResults=True,
    RemoteDefinitionLocation="http://127.0.0.1:5000/createVector",
    RemoteSolveVersion=(0, 1, 0),
    ShowInput_Enabled=False,
    ShowInput_Path=False,
    SynchronousSolve=True)
panel = Panel(createvector)
createcurve = Hops(
    Start=explode_tree.Branch0,
    End=explode_tree.Branch1,
    CacheResultsInMemory=True,
    CacheSolveResults=True,
    RemoteDefinitionLocation="http://127.0.0.1:5000/createCurve",
    RemoteSolveVersion=(0, 1, 0),
    ShowInput_Enabled=False,
    ShowInput_Path=False,
    SynchronousSolve=True)
createcurve_2 = Hops(
    Start=explode_tree.Branch2,
    End=explode_tree.Branch3,
    CacheResultsInMemory=True,
    CacheSolveResults=True,
    RemoteDefinitionLocation="http://127.0.0.1:5000/createLine",
    RemoteSolveVersion=(0, 1, 0),
    ShowInput_Enabled=False,
    ShowInput_Path=False,
    SynchronousSolve=True)
createsurface = Hops(
    CornerA=explode_tree.Branch0,
    CornerB=explode_tree.Branch1,
    CornerC=explode_tree.Branch2,
    CornerD=explode_tree.Branch3,
    CacheResultsInMemory=True,
    CacheSolveResults=True,
    RemoteDefinitionLocation="http://127.0.0.1:5000/createSurface",
    RemoteSolveVersion=(0, 1, 0),
    ShowInput_Enabled=False,
    ShowInput_Path=False,
    SynchronousSolve=True)
merge = Merge(Data1=explode_tree.Branch0, Data2=explode_tree.Branch1, Data3=explode_tree.Branch2, Data4=explode_tree.Branch3)  # -> flatten(Result)
createbrep = Hops(
    Surface=createsurface,
    CacheResultsInMemory=True,
    CacheSolveResults=True,
    RemoteDefinitionLocation="http://127.0.0.1:5000/createBrep",
    RemoteSolveVersion=(0, 1, 0),
    ShowInput_Enabled=False,
    ShowInput_Path=False,
    SynchronousSolve=True)
polyline = PolyLine(Vertices=merge, Closed=False)
deconstruct_brep = DeconstructBrep(Brep=createbrep)  # -> Faces, Edges, Vertices

# ----
# Plane(origin, xPoint, yPoint)
# Initializes a plane from three non-collinear points.
# 
# Parameters:
# origin (rhino3dm.Point3d) – Origin point of the plane.
# xPoint (rhino3dm.Point3d) – Second point in the plane.
# The x-axis will be parallel to x_point-origin.
# yPoint (rhino3dm.Point3d) –
# Third point on the plane that is not collinear
# with the first two points. taxis*(y_point-origin) will be > 0.
# Plane(origin, xDirection, yDirection)
# Constructs a plane from a point and two vectors in the plane.
# 
# Parameters:
# origin (rhino3dm.Point3d) – Origin point of the plane.
# xDirection (rhino3dm.Vector3d) –
# Non-zero vector in the plane that determines the x-axis direction.
# yDirection (rhino3dm.Vector3d) –
# Non-zero vector not parallel to
# x_dir that is used to determine the
# y-axis direction.
# y_dir does not need to be perpendicular to x_dir.
number_slider_6 = Slider(1, range=0..1)
vector_xyz = VectorXYZ(XComponent=0, YComponent=0, ZComponent=number_slider_6)  # -> Vector, Length
# class
# rhino3dm.Planes
# """
# Plane()
# Plane constructor
# 
# Plane(origin, normal)
# Constructs a plane from a point and a normal vector.
# 
# Parameters:
# origin (rhino3dm.Point3d) – Origin point of the plane.
# normal (rhino3dm.Vector3d) – Non-zero normal to the plane.
# """
# plane4
construct_point = ConstructPoint(XCoordinate=0, YCoordinate=0, ZCoordinate=0)
plane4 = Hops(
    Origin=construct_point,
    Normal=vector_xyz.Vector,
    CacheResultsInMemory=True,
    CacheSolveResults=True,
    RemoteDefinitionLocation="http://127.0.0.1:5000/plane4",
    RemoteSolveVersion=(0, 1, 0),
    ShowInput_Enabled=False,
    ShowInput_Path=False,
    SynchronousSolve=True)  # -> Success, Origin, Normal
# """
# Plane()
# Constructs a plane from an equation
# Ax+By+Cz+D=0.
# """
panel_2 = Panel(plane4.Success)
construct_plane = ConstructPlane(Origin=plane4.Origin, XAxis=Vector(1, 0, 0), YAxis=plane4.Normal)
construct_plane_2 = ConstructPlane(Origin=plane4.Origin, XAxis=plane4.Normal, YAxis=Vector(0, 1, 0))
plane_normal = PlaneNormal(Origin=plane4.Origin, ZAxis=plane4.Normal)
