# Grasshopper definition rhino3dm_hops_surfaces_003.gh (Grasshopper 1.0.7)
# plug-ins: Hops, LunchBox

# ----
# createVector
# Breps
# Surfaces
# Points
# Curves
# createLine
# createCurve
number_slider = Slider(15, range=0..100)
number_slider_2 = Slider(35, range=0..100)
number_slider_3 = Slider(45, range=0..100)
number_slider_4 = Slider(6, range=0..100)
# hops server with flask
# rhino3dm in app.py
# Getting Started with
# rhino3dm development
# API for Python 3.10
number_slider_5 = Slider(17, range=0..100)
createpoint = Hops(
    X=[number_slider, number_slider_2, number_slider_3],
    Y=[number_slider, number_slider_2, number_slider_3, number_slider_4],
    Z=[number_slider, number_slider_3, number_slider_4],
    CacheResultsInMemory=True,
    CacheSolveResults=True,
    RemoteDefinitionLocation="http://127.0.0.1:5000/createpoint",
    RemoteSolveVersion=(0, 1, 0),
    ShowInput_Enabled=False,
    ShowInput_Path=False,
    SynchronousSolve=True)
explode_tree = ExplodeTree(Data=graft(createpoint))  # -> Branch0, Branch1, Branch2, Branch3
createvector = Hops(
    X=number_slider_5,
    Y=number_slider_5,
    Z=number_slider_5,
    CacheResultsInMemory=True,
    CacheSolveResults=True,
    RemoteDefinitionLocation="http://127.0.0.1:5000/createVector",
    RemoteSolveVersion=(0, 1, 0),
    ShowInput_Enabled=False,
    ShowInput_Path=False,
    SynchronousSolve=True)
panel = Panel(createvector)
createcurve = Hops(
    Start=explode_tree.Branch0,
    End=explode_tree.Branch1,
    CacheResultsInMemory=True,
    CacheSolveResults=True,
    RemoteDefinitionLocation="http://127.0.0.1:5000/createCurve",
    RemoteSolveVersion=(0, 1, 0),
    ShowInput_Enabled=False,
    ShowInput_Path=False,
    SynchronousSolve=True)
createcurve_2 = Hops(
    Start=explode_tree.Branch2,
    End=explode_tree.Branch3,
    CacheResultsInMemory=True,
    CacheSolveResults=True,
    RemoteDefinitionLocation="http://127.0.0.1:5000/createLine",
    RemoteSolveVersion=(0, 1, 0),
    ShowInput_Enabled=False,
    ShowInput_Path=False,
    SynchronousSolve=True)
createsurface = Hops(
    CornerA=explode_tree.Branch0,
    CornerB=explode_tree.Branch1,
    CornerC=explode_tree.Branch2,
    CornerD=explode_tree.Branch3,
    CacheResultsInMemory=True,
    CacheSolveResults=True,
    RemoteDefinitionLocation="http://127.0.0.1:5000/createSurface",
    RemoteSolveVersion=(0, 1, 0),
    ShowInput_Enabled=False,
    ShowInput_Path=False,
    SynchronousSolve=True)
merge = Merge(Data1=explode_tree.Branch0, Data2=explode_tree.Branch1, Data3=explode_tree.Branch2, Data4=explode_tree.Branch3)  # -> flatten(Result)
createbrep = Hops(
    Surface=createsurface,
    CacheResultsInMemory=True,
    CacheSolveResults=True,
    RemoteDefinitionLocation="http://127.0.0.1:5000/createBrep",
    RemoteSolveVersion=(0, 1, 0),
    ShowInput_Enabled=False,
    ShowInput_Path=False,
    SynchronousSolve=True)
polyline = PolyLine(Vertices=merge, Closed=False)
deconstruct_brep = DeconstructBrep(Brep=createbrep)  # -> Faces, Edges, Vertices

number_slider_6 = Slider(23, range=0..100)
curve = Curve(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)
unit_x = UnitX(Factor=number_slider_6)
move = Move(Geometry=curve, Motion=unit_x)  # -> Geometry, Transform
loft = Loft(
    Curves=flatten([curve, move.Geometry]),
    Options={Adjust=False, Closed=False, LoftEnds=0, LoftSimp=0, LoftType=0, Rebuild=10, Refit=0.01})
gene_pool = GenePool(
    Decimals=2,
    Maximum=1,
    Minimum=0,
    Value=[0.6202191043, 0.02462229786, 0.7009849044, 0.1150506964, 0.1076991754, 0.6176850994, 0.05221544348, 0.423854145, 0.02544633813, 0.1220276836])
gene_pool_2 = GenePool(
    Decimals=2,
    Maximum=1,
    Minimum=0,
    Value=[0.1150543788, 0.5506767438, 0.3508891018, 0.3027219951, 0.6351312057, 0.1461196985, 0.9458308746, 0.7094931364, 0.6224377941, 0.2486950775])
gene_pool_3 = GenePool(
    Decimals=2,
    Maximum=1,
    Minimum=0,
    Value=[0.6202191043, 0.02462229786, 0.7009849044, 0.1150506964, 0.1076991754, 0.6176850994, 0.05221544348, 0.423854145, 0.02544633813, 0.1220276836])
gene_pool_4 = GenePool(
    Decimals=2,
    Maximum=1,
    Minimum=0,
    Value=[0.1150543788, 0.21, 0.05, 0.3027219951, 0.6351312057, 0.1461196985, 0.9458308746, 0.7094931364, 0.6224377941, 0.2486950775])
read_csv = ReadCSV(Delimiter=",")  # -> Headers, Values
# """
# surface span count (direction)
# SpanCount(direction)
# Gets number of smooth nonempty spans in the parameter direction.
# 
# Parameters:	direction (int) –
# 0 gets first parameter’s domain,
# 1 gets second parameter’s domain.
# Returns:	The span count.
# Return type:	int
# """
# srfSpanCount
number_slider_7 = Slider(1, range=0..1)
# """
# surface set domain
# SetDomain(direction, domain)
# Sets the domain in a direction.
# 
# Parameters:
# direction (int) – 0 sets first parameter’s domain, 1 sets second parameter’s domain.
# domain (rhino3dm.Interval) – A new domain to be assigned.
# Returns:
# True if setting succeeded, otherwise false.
# 
# Return type:
# bool
# """
# 
# """
# @hops.component(
#     "/srfSetDomain",
#     name="Set Domain",
#     nickname="SrfSetDomain",
#     description="Surface set domain",
#     inputs=[
#         hs.HopsSurface("Surface", "S", "Surface to evaluate"),
#         hs.HopsNumber("Direction", "D", "Direction"),
#         # this is going to need an interval and no hs. HopsInterval exists currently
#         # need to create and interval component for this to work
#         # put on hold until I can figure out how to do this
#         hs.HopsInterval("Domain", "D", "Domain")
#     ],
#     outputs=[hs.HopsBoolean("Success", "S", "Success")]
# )
# def srf_set_domain(surface: rhino3dm.Surface, direction, domain):
#     return surface.SetDomain(direction, domain)
# """
sphere = Sphere(Base=PlaneXY(0, 0, 0), Radius=number_slider_6)
# """
# surface pointAt(u, v)
# PointAt(u, v)
# Evaluates a point at a given parameter.
# 
# Parameters:
# u (float) – evaluation parameters.
# v (float) – evaluation parameters.
# Returns:
# Point3d.Unset on failure.
# 
# Return type:
# rhino3dm.Point3d
# """
# srfPointAt
number_slider_8 = Slider(1, range=0..1)
# """
# surface is solid
# IsSolid
# bool: Gets a values indicating
# whether a surface is solid.
# """
# srfIsSolid
surface = Surface(loft)
# """
# surface frame(u, v)
# FrameAt(u, v)
# Computes the orient plane on a surface given a U and V parameter. This is the simple evaluation call with no error handling.
# 
# Parameters:
# u (float) – A first parameter.
# v (float) – A second parameter.
# Returns:
# tuple (bool, rhino3dm.Plane)
# BUT WE MUST RETURN AN ORIGIN AND THREE VECTORS INSTEAD FOR NOW
# 
# True if this operation succeeded; otherwise false.
# A frame plane that will be computed during this call.
# Return type:
# (bool, rhino3dm.Plane)
# """
# srfFrame11
number_slider_9 = Slider(0.7, range=0..1)
number_slider_10 = Slider(0.39, range=0..1)
number_slider_11 = Slider(0.51, range=0..2)
# """
# surface degree(direction)
# Degree(direction)
# Returns the maximum algebraic degree of any span
# (or a good estimate if curve spans are not algebraic).
# 
# Parameters:	direction (int) –
# 0 gets first parameter’s domain,
# 1 gets second parameter’s domain.
# Returns:	The maximum degree.
# Return type:	int
# """
# srfDeg
surface_2 = Surface(loft)
# class
# rhino3dm.Surface
srfissolid = Hops(
    Surface=[surface, sphere],
    CacheResultsInMemory=True,
    CacheSolveResults=True,
    RemoteDefinitionLocation="http://127.0.0.1:5000/srfIsSolid",
    RemoteSolveVersion=(0, 1, 0),
    ShowInput_Enabled=False,
    ShowInput_Path=False,
    SynchronousSolve=True)
surface_3 = Surface(surface_2)
srfdeg = Hops(
    Surface=surface_2,
    Direction=number_slider_7,
    CacheResultsInMemory=True,
    CacheSolveResults=True,
    RemoteDefinitionLocation="http://127.0.0.1:5000/srfDeg",
    RemoteSolveVersion=(0, 1, 0),
    ShowInput_Enabled=False,
    ShowInput_Path=False,
    SynchronousSolve=True)
surface_4 = Surface(surface_3)
surface_5 = Surface(surface_4)
srfspancount = Hops(
    Surface=surface_3,
    Direction=number_slider_8,
    CacheResultsInMemory=True,
    CacheSolveResults=True,
    RemoteDefinitionLocation="http://127.0.0.1:5000/srfSpanCount",
    RemoteSolveVersion=(0, 1, 0),
    ShowInput_Enabled=False,
    ShowInput_Path=False,
    SynchronousSolve=True)
panel_2 = Panel(srfissolid)
srfpointat = Hops(
    Surface=reparameterize(surface_4),
    U=Slider(0.44, range=0..1),
    V=number_slider_9,
    CacheResultsInMemory=True,
    CacheSolveResults=True,
    RemoteDefinitionLocation="http://127.0.0.1:5000/srfPointAt",
    RemoteSolveVersion=(0, 1, 0),
    ShowInput_Enabled=False,
    ShowInput_Path=False,
    SynchronousSolve=True)
panel_3 = Panel(srfdeg)
srfframe11 = Hops(
    Surface=reparameterize(surface_5),
    U=gene_pool_4,
    V=gene_pool_3,
    CacheResultsInMemory=True,
    CacheSolveResults=True,
    RemoteDefinitionLocation="http://127.0.0.1:5000/srfFrame11",
    RemoteSolveVersion=(0, 1, 0),
    ShowInput_Enabled=False,
    ShowInput_Path=False,
    SynchronousSolve=True)  # -> Success, Origin, X, Y, Z
panel_4 = Panel(srfspancount)
panel_5 = Panel(srfpointat)
point = Point(srfframe11.Origin)
vector = Vector(srfframe11.X)
vector_2 = Vector(srfframe11.Z)
vector_3 = Vector(srfframe11.Y)
panel_6 = Panel(srfframe11.Success)
vector_display = VectorDisplay(Anchor=point, Vector=vector)
vector_display_2 = VectorDisplay(Anchor=point, Vector=vector_3)
vector_display_3 = VectorDisplay(Anchor=point, Vector=vector_2)
panel_7 = Panel([point, vector, vector_3, vector_2])
construct_plane = ConstructPlane(Origin=point, XAxis=vector, YAxis=vector_2)
# """
# INTERVAL
# """
# """
# create interval(t0, t1)
# Interval(t0, t1)
# Initializes a new instance of the Rhino.Geometry.Interval class.
# 
# Parameters:
# t0 (float) – The first value.
# t1 (float) – The second value.
# T0
# float: Gets or sets the lower bound of the Interval.
# 
# T1
# float: Gets or sets the upper bound of the Interval.
# """
# intervalConcat
number_slider_12 = Slider(0, range=0..1)
# """
# surface domain(direction)
# Domain(direction)
# Gets the domain in a direction.
# 
# Parameters:	direction (int) –
# 0 gets first parameter,
# 1 gets second parameter.
# Returns:	An interval value.
# Return type:	rhino3dm.Interval
# """
number_slider_13 = Slider(1, range=0..1)
surface_6 = Surface(loft)
md_slider = MDSlider(
    SliderMode=0,
    slider_value=Point(0.5829259361, 0.6560974121, 0.5),
    x_domain=Domain(0, 1),
    y_domain=Domain(0, 1),
    z_domain=Domain(0, 1))
# """
# NormalAt(u, v)
# Computes the surface normal at a point.
# This is the simple evaluation call -
#  it does not support error handling.
# 
# Parameters:
# u (float) – A U parameter.
# v (float) – A V parameter.
# Returns:
# The normal.
# 
# Return type:
# rhino3dm.Vector3d
# """
number_slider_14 = Slider(0.51, range=0..1)
geometry = Geometry(surface_6)
intervalconcat = Hops(
    T0=number_slider_12,
    T1=number_slider_13,
    CacheResultsInMemory=True,
    CacheSolveResults=True,
    RemoteDefinitionLocation="http://127.0.0.1:5000/intervalConcat",
    RemoteSolveVersion=(0, 1, 0),
    ShowInput_Enabled=False,
    ShowInput_Path=False,
    SynchronousSolve=True)  # -> T0, T1, Concatenated
evaluate_surface = EvaluateSurface(Surface=reparameterize(geometry), Point=md_slider)  # -> Point, Normal, UDirection, VDirection, Frame
construct_domain² = ConstructDomain²(UMin=Slider(0.26, range=0..1), UMax=Slider(0.51, range=0..1), VMin=Slider(0.26, range=0..1), VMax=number_slider_14)
domain = Domain(intervalconcat.Concatenated)
panel_8 = Panel([intervalconcat.T0, intervalconcat.T1, intervalconcat.Concatenated])
panel_9 = Panel(domain)
construct_domain = ConstructDomain(DomainStart=number_slider_12, DomainEnd=number_slider_13)
vector_4 = Vector(evaluate_surface.Normal)
panel_10 = Panel(construct_domain²)
panel_11 = Panel(vector_4)
vector_display_4 = VectorDisplay(Anchor=vector_4, Vector=vector_4)
